# Grasshopper definition loadJSON.gh (Grasshopper 1.0.7)
# plug-ins: ShapeDiverForGrasshopper

# JSONbackend.txt
path = FilePath("D:\IAAC\04_Thesis\CloudBasedGraphMachineLearningFrontend\backup\JSONbackend.txt")
# JSONfrontend.txt
path_2 = FilePath("D:\IAAC\04_Thesis\CloudBasedGraphMachineLearningFrontend\backup\JSONfrontend.txt")
file = ReadFile(File=path, PerLineParse=False)
file_2 = ReadFile(File=path_2, PerLineParse=False)
parsejson = ParseJSON(JSON=file)
parsejson_2 = ParseJSON(JSON=file_2)
accessjson = AccessJSON(Object=parsejson, AddressString="features")
accessjson_2 = AccessJSON(Object=parsejson_2, AddressString="geometry")
accessjson_3 = AccessJSON(Object=accessjson, AddressString="node")
accessjson_4 = AccessJSON(Object=accessjson, AddressString="edge")
accessjson_5 = AccessJSON(Object=accessjson_2, AddressString="coordinates")
accessjson_6 = AccessJSON(Object=accessjson_2, AddressString="type")
expression = Expression(x=accessjson_6, Expression="x=\"Polygon\"")
item = ListItem(List=accessjson_5, Index=0, Wrap=True)  # -> Item, Item1, Item2
accessjson_7 = AccessJSON(Object=accessjson_3, AddressString="properties")
accessjson_8 = AccessJSON(Object=accessjson_4, AddressString="properties")
pt = ConstructPoint(XCoordinate=item.Item, YCoordinate=item.Item1, ZCoordinate=0)
accessjson_9 = AccessJSON(Object=accessjson_7, AddressString="metadata")
accessjson_10 = AccessJSON(Object=accessjson_8, AddressString="source")
pline = PolyLine(Vertices=flatten(pt), Closed=expression)
panel = Panel(accessjson_10)
accessjson_11 = AccessJSON(Object=accessjson_9, AddressString="geometry")
accessjson_12 = AccessJSON(Object=accessjson_11, AddressString="coordinates")
panel_2 = Panel(accessjson_11)
item_2 = ListItem(List=accessjson_12, Index=0, Wrap=True)  # -> Item, Item1, Item2
pt_2 = ConstructPoint(XCoordinate=item_2.Item, YCoordinate=item_2.Item1, ZCoordinate=item_2.Item2)
